# Grasshopper definition crv.gh (Grasshopper 1.0.7)

pt = Point(Point(-0.2675956937, -0.3254790137, 0))
input_pt = GetPoint(pt, AtLeast=1, AtMost=1, Realtime=True, TreeAccess=False)
input_int = GetInteger(Slider(5, range=0..10), AtLeast=1, AtMost=1, Maximum=2147483647, Minimum=-2147483648, TreeAccess=False)
cir = Circle(Plane=input_pt, Radius=input_int)

# ---- group: RH_OUT:crv
brep = Brep(cir)
